# Grasshopper definition transform_revit_ecs_to_epsg-p2326-v5738.gh (Grasshopper 1.0.8)
# Copyright: Arup
# plug-ins: eleFront, Speckle.Connector.Grasshopper

speckle_model = SpeckleModel(
    Model="7f2a89be04",
    Project="34b188cb10",
    Server="https://app.speckle.systems",
    User="80EEB7BBE4744244BEF9F42A8D144D75",
    Workspace="b6415b8ed6")
speckle_model_2 = SpeckleModel(
    Model="55ab2430e5",
    Project="34b188cb10",
    Server="https://app.speckle.systems",
    User="80EEB7BBE4744244BEF9F42A8D144D75",
    Workspace="b6415b8ed6")
load = Load(SpeckleModel=speckle_model, AutoReceive=False)
load_2 = Load(SpeckleModel=speckle_model_2, AutoReceive=False)
revit_advanced_sample_arch_spklcollectio = EleFrontDataDescription(load, ShiftDepth=0, isNameSet=True)  # "Revit Advanced Sample Arch_SpklCollection"
revit_advanced_sample_str_spklcollection = EleFrontDataDescription(load_2, ShiftDepth=0, isNameSet=True)
collection_selector = CollectionSelector(revit_advanced_sample_str_spklcollection, AutoSelectAllItems=False)
revit_advanced_sample_arch_spklcollectio_2 = EleFrontDataDescription(revit_advanced_sample_arch_spklcollectio, ShiftDepth=0, isNameSet=True)  # "Revit Advanced Sample Arch_SpklCollection"
revit_advanced_sample_str_spklcollection_2 = EleFrontDataDescription(revit_advanced_sample_str_spklcollection, ShiftDepth=0, isNameSet=True)
easting = Slider(838809.3, range=838780..838840)
northing = Slider(819822.3, range=819785..819845)
height = Slider(6.6, range=0..10)
rotation = Slider(136, range=0..360)
query_speckle_objects = QuerySpeckleObjects(Collection=revit_advanced_sample_arch_spklcollectio_2)
query_speckle_objects_2 = QuerySpeckleObjects(Collection=revit_advanced_sample_str_spklcollection_2, Path=collection_selector)
speckle_objects = EleFrontDataDescription(query_speckle_objects, ShiftDepth=0, isNameSet=True)
speckle_block_instance = SpeckleBlockInstance(graft(query_speckle_objects_2))
vector_xyz = VectorXYZ(XComponent=easting, YComponent=northing, ZComponent=height)  # -> Vector, Length
radians = Radians(Degrees=rotation)
xy_plane = XYPlane(Origin=Point(0, 0, 0))
data = Data(speckle_objects)
suirify = Suirify(data)
move = Move(Motion=vector_xyz.Vector)  # -> Geometry, Transform
rotate = Rotate(Angle=radians, Plane=xy_plane)  # -> Geometry, Transform
speckle_block_instance_2 = SpeckleBlockInstance(BlockInstance=speckle_block_instance)  # -> BlockInstance, Definition, Transform, Name, Properties, Color, Material
foundation_speckle_block_instance = EleFrontDataDescription(speckle_block_instance, ShiftDepth=0, isNameSet=True)
speckle_objects_2 = EleFrontDataDescription(suirify, ShiftDepth=0, isNameSet=True)
panel = Panel("""Speckle Data Object*
Speckle Geometry*
Speckle Block Instance*""")
merge = Merge(Data1=rotate.Transform, Data2=move.Transform)
transform = Transform(speckle_block_instance_2.Transform)
speckle_objects_3 = EleFrontDataDescription(speckle_objects_2, ShiftDepth=0, isNameSet=False)
text = Text(graft(panel))
text_2 = Text(speckle_objects_2)
compound = Compound(Transforms=merge)
match_text = MatchText(Text=text_2, Pattern=text, Case=True)
speckle_objects_4 = EleFrontDataDescription(speckle_objects_3, ShiftDepth=0, isNameSet=False)
transform_2 = Transform(compound)
cull_pattern = CullPattern(List=speckle_objects_4, CullPattern=match_text)
cross_reference = CrossReference(ListListA=transform, ListListB=transform_2, CrossMode=1)  # -> ListListA, ListListB
transform_3 = Transform(cross_reference.ListListA)
transform_4 = Transform(cross_reference.ListListB)
explode_tree = ExplodeTree(Data=cull_pattern)  # -> Branch0, Branch1, Branch2
merge_2 = Merge(Data1=transform_3, Data2=transform_4)
speckle_block_instance_3 = SpeckleBlockInstance(explode_tree.Branch2)
speckle_data_object = SpeckleDataObject(explode_tree.Branch0)
speckle_geometry = SpeckleGeometry(explode_tree.Branch1)
speckle_block_instance_4 = EleFrontDataDescription(speckle_block_instance_3, ShiftDepth=0, isNameSet=False)
speckle_data_object_2 = EleFrontDataDescription(speckle_data_object, ShiftDepth=0, isNameSet=False)
speckle_geometry_2 = EleFrontDataDescription(speckle_geometry, ShiftDepth=0, isNameSet=False)
compound_2 = Compound(Transforms=merge_2)
model_block_instance = ModelBlockInstance(BlockInstance=speckle_block_instance, Transform=compound_2)  # -> BlockInstance, Transform, BlockDefinition
speckle_block_instance_5 = SpeckleBlockInstance(BlockInstance=speckle_block_instance_2.BlockInstance, Transform=compound_2)  # -> BlockInstance, Definition, Transform, Name, Properties, Color, Material
block_instance = BlockInstance(model_block_instance.BlockInstance)
model_block_instance_2 = ModelBlockInstance(BlockInstance=speckle_block_instance_5.BlockInstance)  # -> BlockInstance, Transform, BlockDefinition
ecs_to_projected_crs_transform = EleFrontDataDescription(ShiftDepth=0, isNameSet=True)
construct_point = ConstructPoint(XCoordinate=0, YCoordinate=0, ZCoordinate=0)
block_instance_2 = BlockInstance(model_block_instance_2.BlockInstance)
speckle_data_object_3 = SpeckleDataObject(SpeckleDataObject=speckle_data_object_2)  # -> SpeckleDataObject, Geometries, Name, Properties, Path
model_block_instance_3 = ModelBlockInstance(BlockInstance=speckle_block_instance_4)  # -> BlockInstance, Transform, BlockDefinition
point = Point(construct_point)
foundation_speckle_block_instance_2 = EleFrontDataDescription(foundation_speckle_block_instance, ShiftDepth=0, isNameSet=False)
ecs_to_projected_crs_transform_2 = EleFrontDataDescription(ecs_to_projected_crs_transform, ShiftDepth=0, isNameSet=False)
block_instance_3 = BlockInstance(model_block_instance_3.BlockInstance)
create_collection = CreateCollection(SubCollection1=block_instance_3, AlwaysInheritNames=False)
model_object = ModelObject(Object=speckle_data_object_3.SpeckleDataObject)  # -> Object, Geometry, Name, Layer, Visibility, Display, Drafting, Render
transform_5 = Transform(Geometry=block_instance_3)
speckle_geometry_3 = SpeckleGeometry(SpeckleGeometry=speckle_data_object_3.Geometries)  # -> SpeckleGeometry, Geometry, Name, Properties, Color, Material, Path
transform_6 = Transform(Geometry=speckle_data_object_3.Geometries, Transform=compound_2)
