# Grasshopper definition maastoren_foundation.gh (Grasshopper 1.0.8)
# Copyright: Arup

mesh = Mesh([<mesh referenced from the Rhino model> x9])
query_model_objects = QueryModelObjects(Layer="Layer 04::09", Locked=True, Hidden=True, AutoUpdateState=True)
query_model_objects_2 = QueryModelObjects(Layer="Layer 03", Locked=True, Hidden=True, AutoUpdateState=True)
boorpuntdiameter_mm = Panel("670")
schachtdiameter_mm = Panel("559")
mesh_join = MeshJoin(Meshes=mesh)
boundary_surfaces = BoundarySurfaces(Edges=query_model_objects)
multiplication = Multiplication(A=boorpuntdiameter_mm, B="0.5")
area = Area(Geometry=mesh_join)  # -> Area, Centroid
point = Point(query_model_objects_2)
afhakhoogte_m_nap = Panel("-3.25")
deconstruct = Deconstruct(Point=point)  # -> XComponent, YComponent, ZComponent
paalpuntniveau_m_nap = Panel("-23.5")
area_2 = Area(Geometry=boundary_surfaces)  # -> Area, Centroid
point_2 = Point(area.Centroid)
content_cache = ContentCache(Content=point_2)
content_cache_2 = ContentCache(Content=area_2.Centroid)
multiplication_2 = Multiplication(A=afhakhoogte_m_nap, B="1000")
multiplication_3 = Multiplication(A="1000", B=paalpuntniveau_m_nap)
construct_point = ConstructPoint(XCoordinate=deconstruct.XComponent, YCoordinate=deconstruct.YComponent, ZCoordinate=multiplication_2)
construct_point_2 = ConstructPoint(XCoordinate=deconstruct.XComponent, YCoordinate=deconstruct.YComponent, ZCoordinate=multiplication_3)
line = Line(StartPoint=construct_point, EndPoint=construct_point_2)
pipe = Pipe(Curve=line, Radius=multiplication, Caps="1", FitRail=False)
content_cache_3 = ContentCache(Content=pipe)
